# Grasshopper definition GH READER.gh (Grasshopper 1.0.7)

path = FilePath("D:\IAAC\03_TERM3\02_GEO_OPT\VS CODE\A1\test.py")
file = ReadFile(F=path, PerLineParse=False)  # -> C
#   port F: Uri of file to read
# ---------- file: VB line parser ----------
    action = GH_LineParserAction.Include
    Return line

    'Parse the line and return some data that represents the line.
    'If the line cannot be parsed, you can return Nothing and
    'assign a different action.
    'The default implementation is to just return the line itself.
    'If you return types that implement IGH_Goo, this component
    'will work substantially faster.
# ---------- end file ----------
panel = Panel(file)
python = GhPythonScript(Code=file)  # -> Out, A, B
panel_2 = Panel(python.Out)
data = Data(python.A)
data_2 = Data(python.B)
panel_3 = Panel(python.B)
