# Grasshopper definition GrasshopperToPython_session02.gh (Grasshopper 1.0.7)

pt = Point([Point(-35.10941202, 7.980240582, 0), Point(-4.577033166, 7.980240582, 0), Point(-4.577033166, -12.4818098, 0), Point(-38.96613355, -12.4818098, 0)])
# 1. list
series = Series(Start=0, Step=1, Count=10)
# basic mesh
python = GhPythonScript(pts=pt)  # -> out, a; inputs pts: list of Point3d
# ---------- python: Python ----------
import Rhino.Geometry as rg

#create a Mesh
mesh = rg.Mesh()

#list of vertices
#print mesh.Vertices

#add vertices to list
for p in pts:
    mesh.Vertices.Add(p)
    
print len(mesh.Vertices)

b = mesh.Vertices
#list of faces
print len(mesh.Faces)
mesh.Faces.AddFace(0,1,2,3)


a = mesh
# ---------- end python ----------
# Dai's approach
python_2 = GhPythonScript(x=Slider(2, range=0..10), U=Slider(10, range=0..10), V=Slider(10, range=0..10))  # -> out, a, b, c, d, e, f, g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; inputs x: Int32, U: Int32, V: Int32
# ---------- python_2: Python ----------
import Rhino.Geometry as rg
import ghpythonlib.treehelpers as th
import math
import ghpythonlib.components as ghc

point1 = rg.Point3d(0,0,0)

a = point1

#this is how you initialize a list in python
pointList1 = []
for i in range(10):
    pt = rg.Point3d(i, 0, 0)
    pointList1.append(pt)

#print pointList1
a = pointList1

#make a second list of points
pointList2 = []
for i in range(10):
    pt = rg.Point3d(i, 20, 0)
    pointList2.append(pt)

#print pointList2
b = pointList2

#Create a line from two lists
line = rg.Line(pointList1[x], pointList2[x])
c = line


lineList = []
for i in range(len(pointList1)):
    line = rg.Line(pointList1[i], pointList2[i])
    lineList.append(line)
c = lineList


#divide line into points

"""
midPt = rg.Line.PointAt(lineList[x], 0.5)
d = midPt
"""


allDivPts = []
for j in range(len(lineList)):
    divPts = [] #my list of division points
    for i in range(11):
        divPt = rg.Line.PointAt(lineList[j], i/10)
        
        vec= rg.Vector3d(divPt)
        vecLen = vec.Length
        mag = math.sin(vecLen)
        transVec = -rg.Vector3d.ZAxis * mag
        
        newPt = divPt - transVec
        divPts.append(newPt)

    allDivPts.append(divPts)

d = th.list_to_tree(allDivPts)


#make a curve from list of points
curveList = []
for i in range(len(allDivPts)):
    curve = rg.Curve.CreateInterpolatedCurve(allDivPts[i], 3)
    curveList.append(curve)
e= curveList


#create a loft surface from curves
surface = rg.Brep.CreateFromLoft(curveList, rg.Point3d.Unset, rg.Point3d.Unset, rg.LoftType.Normal, False)
f = surface

#extract surface fromBrep
nSrf= surface[0].Surfaces[0]
g = nSrf

#reparametrize surface
nSrf.SetDomain(0,rg.Interval(0,U))
nSrf.SetDomain(1,rg.Interval(0,V))

#get points
pts=[]
for i in range(U+1):
    for j in range(V+1):
        pt=rg.Surface.PointAt(nSrf,i,j)
        pts.append(pt)
h = pts


#sort list of points
sorted_points=[]
for i in range(len(pts)-(V+2)):
    sub=[]
    if ((i != V and ((i - V) % (V+1)!=0)) or i==0):
        for j in range(1):
            point1=pts[i]
            point2=pts[i+1]
            point3=pts[i+V+2]
            point4=pts[i+V+1]
            sub.extend([point1,point2,point3,point4])

        sorted_points.append(sub)

i=th.list_to_tree(sorted_points)

## Build faces
mesh_vertices=[]
meshfaces=[]
mesh=rg.Mesh()
for i in sorted_points:
    sub=[]
    for j in range(4):
        a=mesh.Vertices.Add(i[j])
        sub.append(a)
    mesh_vertices.append(sub)

for i in mesh_vertices:
    face=rg.MeshFace(i[0],i[1],i[2],i[3])
    mesh.Faces.AddFace(face)

j=mesh
# ---------- end python_2 ----------
# Dai's approach (simplified)
python_3 = GhPythonScript(x=Slider(2, range=0..10), U=Slider(10, range=0..10), V=Slider(10, range=0..10))  # -> out, a, b, c, d, e, f, g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; inputs x: Int32, U: Int32, V: Int32
# ---------- python_3: Python ----------
import Rhino.Geometry as rg
import ghpythonlib.treehelpers as th
import math
import ghpythonlib.components as ghc

point1 = rg.Point3d(0,0,0)

a = point1

#this is how you initialize a list in python
pointList1 = []
for i in range(U+1):
    pt = rg.Point3d(i, 0, 0)
    pointList1.append(pt)

#print pointList1
a = pointList1

#make a second list of points
pointList2 = []
for i in range(V+1):
    pt = rg.Point3d(i, 20, 0)
    pointList2.append(pt)

#print pointList2
b = pointList2

#Create a line from two lists
line = rg.Line(pointList1[x], pointList2[x])
c = line


lineList = []
for i in range(len(pointList1)):
    line = rg.Line(pointList1[i], pointList2[i])
    lineList.append(line)
c = lineList


#divide line into points

"""
midPt = rg.Line.PointAt(lineList[x], 0.5)
d = midPt
"""


allDivPts = []
for j in range(len(lineList)):
    divPts = [] #my list of division points
    for i in range(11):
        divPt = rg.Line.PointAt(lineList[j], i/10)
        
        vec= rg.Vector3d(divPt)
        vecLen = vec.Length
        mag = math.sin(vecLen)
        transVec = -rg.Vector3d.ZAxis * mag
        
        newPt = divPt - transVec
        divPts.append(newPt)

    allDivPts.append(divPts)

d = th.list_to_tree(allDivPts)


#make a curve from list of points
curveList = []
for i in range(len(allDivPts)):
    curve = rg.Curve.CreateInterpolatedCurve(allDivPts[i], 3)
    curveList.append(curve)
e= curveList


#create a loft surface from curves
surface = rg.Brep.CreateFromLoft(curveList, rg.Point3d.Unset, rg.Point3d.Unset, rg.LoftType.Normal, False)
f = surface

#extract surface fromBrep
nSrf= surface[0].Surfaces[0]
g = nSrf




pts = []
for plist in allDivPts:
    for p in plist:
        pts.append(p)


#sort list of points
sorted_points=[]
for i in range(len(pts)-(V+2)):
    sub=[]
    if ((i != V and ((i - V) % (V+1)!=0)) or i==0):
        for j in range(1):
            point1=pts[i]
            point2=pts[i+1]
            point3=pts[i+V+2]
            point4=pts[i+V+1]
            sub.extend([point1,point2,point3,point4])

        sorted_points.append(sub)

i=th.list_to_tree(sorted_points)

## Build faces
mesh_vertices=[]
meshfaces=[]
mesh=rg.Mesh()
for i in sorted_points:
    sub=[]
    for j in range(4):
        a=mesh.Vertices.Add(i[j])
        sub.append(a)
    mesh_vertices.append(sub)

for i in mesh_vertices:
    face=rg.MeshFace(i[0],i[1],i[2],i[3])
    mesh.Faces.AddFace(face)

j=mesh
# ---------- end python_3 ----------
# 2. points
pt_2 = ConstructPoint(XCoordinate=series, YCoordinate=0, ZCoordinate=0)
pt_3 = ConstructPoint(XCoordinate=series, YCoordinate=Slider(10, range=0..10), ZCoordinate=0)
data = Data(python_2.g)
data_2 = Data(python_2.f)
data_3 = Data(python_2.d)
data_4 = Data(python_2.j)
data_5 = Data(python_3.d)
data_6 = Data(python_3.g)
data_7 = Data(python_3.f)
data_8 = Data(python_3.j)
# 3. line
ln = Line(StartPoint=pt_2, EndPoint=pt_3)
# 4. divide curve
divide = DivideCurve(Curve=ln, Count=10, Kinks=False)  # -> Points, Tangents, Parameters
vec = Vector(divide.Points)
# David's approach
python_4 = GhPythonScript(x=Slider(2, range=0..10), U=Slider(10, range=0..10), V=Slider(10, range=0..10))  # -> out, a, b, c, d, e, f, g, h; inputs x: Int32, U: Int32, V: Int32
# ---------- python_4: Python ----------
import Rhino.Geometry as rg
import ghpythonlib.treehelpers as th
import math
import ghpythonlib.components as ghc

point1 = rg.Point3d(0,0,0)

a = point1

#this is how you initialize a list in python
pointList1 = []
for i in range(10):
    pt = rg.Point3d(i, 0, 0)
    pointList1.append(pt)

#print pointList1
a = pointList1

#make a second list of points
pointList2 = []
for i in range(10):
    pt = rg.Point3d(i, 20, 0)
    pointList2.append(pt)

#print pointList2
b = pointList2

#Create a line from two lists
line = rg.Line(pointList1[x], pointList2[x])
c = line


lineList = []
for i in range(len(pointList1)):
    line = rg.Line(pointList1[i], pointList2[i])
    lineList.append(line)
c = lineList


#divide line into points

"""
midPt = rg.Line.PointAt(lineList[x], 0.5)
d = midPt
"""


allDivPts = []
for j in range(len(lineList)):
    divPts = [] #my list of division points
    for i in range(11):
        divPt = rg.Line.PointAt(lineList[j], i/10)
        
        vec= rg.Vector3d(divPt)
        vecLen = vec.Length
        mag = math.sin(vecLen)
        transVec = -rg.Vector3d.ZAxis * mag
        
        newPt = divPt - transVec
        divPts.append(newPt)

    allDivPts.append(divPts)

d = th.list_to_tree(allDivPts)


#make a curve from list of points
curveList = []
for i in range(len(allDivPts)):
    curve = rg.Curve.CreateInterpolatedCurve(allDivPts[i], 3)
    curveList.append(curve)
e= curveList


#create a loft surface from curves
surface = rg.Brep.CreateFromLoft(curveList, rg.Point3d.Unset, rg.Point3d.Unset, rg.LoftType.Normal, False)
f = surface

mesh = rg.Mesh()
for i in range(len(allDivPts)-1):
    for j in range(len(allDivPts[i])-1):
        m = rg.Mesh()
        v1 = allDivPts[i][j]
        v2 = allDivPts[i][j+1]        
        v3 = allDivPts[i+1][j+1]        
        v4 = allDivPts[i+1][j]
        
        m.Vertices.Add(v1)
        m.Vertices.Add(v2)
        m.Vertices.Add(v3)
        m.Vertices.Add(v4)
        
        m.Faces.AddFace(0,1,2,3)
        
        mesh.Append(m)

g = mesh

cleanmesh = mesh
#methods to clean a mesh
cleanmesh.Normals.ComputeNormals()
cleanmesh.Vertices.CombineIdentical(True, True)
cleanmesh.Vertices.CullUnused()
cleanmesh.Weld(3.14159265358979)
cleanmesh.UnifyNormals()
cleanmesh.FaceNormals.ComputeFaceNormals()
cleanmesh.Compact()


h = cleanmesh
# ---------- end python_4 ----------
vlen = VectorLength(Vector=vec)
sin = Sine(Value=vlen)
data_9 = Data(python_4.f)
data_10 = Data(python_4.d)
data_11 = Data(python_4.h)
data_12 = Data(python_4.g)
Z = UnitZ(Factor=sin)
# 5. vector
move = Move(Geometry=divide.Points, Motion=Z)  # -> Geometry, Transform
# 6. curve
intcrv = Interpolate(Vertices=move.Geometry, Degree=3, Periodic=False, KnotStyle=1)  # -> Curve, Length, Domain
# 7. surface
loft = Loft(
    Curves=flatten(intcrv.Curve),
    Options={Adjust=False, Closed=False, LoftEnds=0, LoftSimp=0, LoftType=0, Rebuild=10, Refit=0.01})
# 8. mesh
mesh_uv = MeshSurface(Surface=loft, UCount=Slider(10, range=0..10), VCount=Slider(7, range=0..10), Overhang=True, Equalize=False)
